# Grasshopper definition Claystruder_0.1.gh (Grasshopper 0.9.76)
# plug-ins: Heteroptera, MeshEdit Components, Weaverbird, Mesh Pipe, TT Toolbox

layer_height = Slider(2.4, range=0..5)
series = Series(Start=0, Step=layer_height, Count=Slider(30, range=1..50))
cir = Circle(Plane=PlaneXY(0, 0, 0), Radius=Slider(60, range=0..100))
Z = UnitZ(Factor=series)
move = Move(Geometry=cir, Motion=Z)  # -> Geometry, Transform
# eigenvase
crv = Curve([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])
# boid tower
crv_2 = Curve([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])
# cylinder (test)
crv_3 = Curve(move.Geometry)

# ----
# curves reference point
# 0
pt = Point(Point(0, 0, 0))
# curves
crv_4 = Curve(crv)

# ----
# geometry
# IK
# IK solver: 3 works for most cases
# 
# In case of trouble try also other solver modes
# IK calculation: WARNING: depending on the number of frames, it might take some time to process. Give it some time to do its job.
# robot
# fly_per precision: interpolation precision for the robot arm: interpolates acceleration/deceleration ramps and goes a bit far from the points.
# 
# max precision 0<>100 max interpolation
# ARM override: percent speed of the robot arm
# extruder controls: Extruder controls regulate tyhe min-max speed of the extruder motor.
# 
# 0 = stop motor
# 255 = motor max speed
# deposition
# file
# display
robot_position = Slider(0.93041, range=0..1)
custom_subdir = Panel("ClayStruder\pdlFile")
arm_interpolation_mode = ValueList({"Move Linear": 0, "MoveFly Linear": 1, "Move Joint": 2, "MoveFly Joint": 3}, selected="MoveFly Linear")
display_deposition_as = ValueList({"points": 0, "spheres": 1, "none": 2}, selected="spheres")
extrusion_mode = ValueList({"Stop&run": 0, "Run": 1}, selected="Stop&run")
local_directory = ValueList({"Desktop": 0, "C:": 1, "Documents": 2}, selected="Desktop")
ik_solver = Slider(3, range=0..7)
speed = ValueList({"Costant Speed": 0, "Variable Speed": 1}, selected="Costant Speed")
file_name = Panel("EigenVase")
curves = ValueList({"whole list": 0, "sample": 1}, selected="sample")
save_pdl_file = Button()
calculate_ik = BooleanToggle(True)
fly_per_precision = Panel("20")
tool_offset = Panel("""X=62
Y=0
Z=433""")
arm_override_print = Panel("40")
arm_override_move = Panel("5")
z_squeeze = Panel("0.5")
z_retraction = Panel("5")
arm_idle_angles = Panel("""0
-90
90
0
0
0""")
robot_0 = Panel("0,0,0")
work_plane_0 = Panel("1550,0,642")

vec2pt = Vector2Pt(PointA=pt, PointB=work_plane_0, Unitize=False)  # -> Vector, Length
sublist_for_testing = Slider(10, range=0..100)
# involved plugins:
# 
# . heteroptera
# . human
# . mesh utilities in MilkBox
# . WeaverBird
# . mesh edit
move_2 = Move(Geometry=crv_4, Motion=vec2pt.Vector)  # -> Geometry, Transform

extr_max_speed = Slider(255, range=0..255)
extr_min_speed = Slider(0, range=0..255)

subset = SubList(List=move_2.Geometry, Domain=sublist_for_testing, Wrap=False)  # -> List, Index
filter = StreamFilter(Gate=curves, Stream0=move_2.Geometry, Stream1=subset.List)

# ----
# subdivision
step_lenght = Slider(3, range=0..10)
# 1
divlength = DivideLength(Curve=flatten(filter), Length=step_lenght)  # -> Points, Tangents, Parameters

fragment = TextFragment(Text=tool_offset, Start="2")

# ----
# point list fix for retraction
item = ListItem(List=divlength.Points, Index=0, Wrap=True)
merge = Merge(Data1=simplify(divlength.Points), Data2=simplify(item))
rev = ReverseList(List=merge)
Z_2 = UnitZ(Factor=z_squeeze)
# 2
item_2 = ListItem(List=merge, Index=0, Wrap=True)
Z_3 = UnitZ(Factor=z_retraction)
item_3 = ListItem(List=rev, Index=0, Wrap=True)
rev_2 = Reverse(Vector=Z_2)
move_3 = Move(Geometry=item_2, Motion=Z_3)  # -> Geometry, Transform
move_4 = Move(Geometry=item_3, Motion=Z_3)  # -> Geometry, Transform
move_5 = Move(Geometry=item_3, Motion=rev_2)  # -> Geometry, Transform
merge_2 = Merge(Data1=move_3.Geometry, Data2=merge, Data3=move_5.Geometry, Data4=move_4.Geometry)
filter_2 = StreamFilter(Gate=extrusion_mode, Stream0=merge_2, Stream1=divlength.Points)

# ----
# 5
item_4 = ListItem(List=fragment, Index=0, Wrap=True)  # -> Item, Item1, Item2
# robot plane to point
# (for FK)
neg = Negative(Value=item_4.Item2)
height_overhead = Slider(35, range=0..100)
nozzle_radius = Slider(2.5, range=0.1..10)
upper_radius = Slider(14, range=10..100)
nozzle_height = Slider(46, range=0..100)

vec = VectorXYZ(XComponent=item_4.Item, YComponent=item_4.Item1, ZComponent=neg)  # -> Vector, Length
# point to robot plane
# (for IK)
rev_3 = Reverse(Vector=vec.Vector)

devec = DeconstructVector(Vector=vec.Vector)  # -> XComponent, YComponent, ZComponent
neg_2 = Negative(Value=devec.ZComponent)
neg_3 = Negative(Value=devec.YComponent)
Y = UnitY(Factor=neg_3)

pt_2 = Point(filter_2)

# ----
# geometry
# robot head plane alignment
# 3
X = UnitX(Factor=1)
pl = PlaneNormal(Origin=pt_2, ZAxis=X)
move_6 = Move(Geometry=pl, Motion=rev_3)  # -> Geometry, Transform
# 4
pln = Plane(move_6.Geometry)

# ----
# variable speed example (3 point field)
flatten = FlattenTree(Tree=pln, Path="{0}")
flatten_2 = FlattenTree(Tree=pt_2, Path="{0}")
number_slider = Slider(5, range=0..100)
number_slider_2 = Slider(80, range=0..100)
pt_3 = Point([Point(1448, -160, 842), Point(1393, 121, 858), Point(1642, 24, 841)])
# 9
jelloctor = JellumAttractor(Attractors=pt_3, Points=flatten)
dom = ConstructDomain(DomainStart=number_slider_2, DomainEnd=number_slider)
remap = RemapNumbers(Value=jelloctor, Source=Domain(0, 1), Target=dom)  # -> Mapped, Clipped
gradient = Gradient(
    LowerLimit=number_slider_2,
    UpperLimit=number_slider,
    Parameter=remap.Mapped,
    stops=[0: RGB(0, 128, 0), 0.5: RGB(255, 255, 0), 1: RGB(255, 0, 0)])
# display
panel = Panel("3")
msphere = MeshSphere(Base=flatten_2, Radius=nozzle_radius, UCount="4", VCount=panel)  # disabled
match = MatchTreeStructure(DataList=flatten(remap.Mapped), TreeMask=pln)
preview = CustomPreview(Geometry=msphere, Shader=gradient)

bbox = BoundingBox(Content=filter, Plane=PlaneXY(0, 0, 0), UnionBox=True)  # -> Box, Box_2
edges = BrepEdges(Brep=bbox.Box)  # -> Naked, Interior, NonManifold
panel_2 = Panel("""0
1
9""")
box_corners = BoxCorners(Box=bbox.Box)  # -> CornerA, CornerB, CornerC, CornerD, CornerE, CornerF, CornerG, CornerH
item_5 = ListItem(List=edges.Interior, Index=panel_2, Wrap=True)
len = Length(Curve=item_5)
xy = XYPlane(Origin=[box_corners.CornerA, box_corners.CornerB, box_corners.CornerC, box_corners.CornerD, box_corners.CornerE, box_corners.CornerF, box_corners.CornerG, box_corners.CornerH])
item_6 = ListItem(List=len, Index=0, Wrap=True)  # -> Item, Item1
sort = SortList(Keys=len)  # -> reverse(Keys), ValuesA
panel_3 = Panel(len)
num = Number("10")
crosshair = CSharpScript(P=xy, S=num)  # -> out, A
# ---------- crosshair: C# ----------
    Plane pp = (Plane) P;
    double sz = S != null ? ((double) S) : 1;
    Point3d px1 = Point3d.Add(pp.Origin,  new Point3d(- sz*.5, 0, 0));
    Point3d px2 = Point3d.Add(pp.Origin,  new Point3d(sz*.5, 0, 0));
    Point3d py1 = Point3d.Add(pp.Origin,  new Point3d(0, -sz*.5, 0));
    Point3d py2 = Point3d.Add(pp.Origin,  new Point3d(0, sz*.5,  0));
    //Point3d p1 = Point3d.Add(pp.Origin, new Point3d(size*.5, 0, 0));
    Line[] l = new Line[2];
    l[0] = new Line(px1, px2);
    l[1] = new Line(py1, py2);
    A = l;
    //l[1] = new Line(pp.Origin.Add(new Point3
# ---------- end crosshair ----------
item_7 = ListItem(List=sort.Keys, Index=0, Wrap=True)
multiplication = Multiplication(A=item_6.Item, B=0.7)
multiplication_2 = Multiplication(A=item_6.Item1, B=0.7)
xy_2 = XYPlane(Origin=work_plane_0)
neg_4 = Negative(Value=multiplication_2)
neg_5 = Negative(Value=multiplication)
multiplication_3 = Multiplication(A=item_7, B=2)
dom_2 = ConstructDomain(DomainStart=neg_5, DomainEnd=multiplication)
dom_3 = ConstructDomain(DomainStart=neg_4, DomainEnd=multiplication_2)
crosshair_2 = CSharpScript(P=xy_2, S=multiplication_3)  # -> out, A; same code as crosshair
planesrf = PlaneSurface(Plane=xy_2, XSize=dom_2, YSize=dom_3)
# work plane & bounds display
swatch = ColourSwatch(SwatchColor=RGB(99, 99, 99))  # disabled
preview_2 = CustomPreview(Geometry=[planesrf, crosshair_2.A], Shader=ColourSwatch(SwatchColor=RGBA(181, 181, 181, 50)))
preview_3 = CustomPreview(Geometry=filter, Shader=swatch)  # disabled
preview_4 = CustomPreview(Geometry=crosshair.A, Shader=ColourSwatch(SwatchColor=RGB(0, 0, 0)))

disp_axes = CSharpScript()  # inputs X: Int32, D: tree, N: Double, L: list of Line, A: list of Double; disabled
# ---------- disp_axes: C# ----------
    axes = new Line[6];
    textPos = new Point3d[6];
    status = new int[6];
    angles = new double[6];
    bb = new BoundingBox();
    int frameCount = Convert.ToInt32(D.BranchCount / 6f);
    int index = Math.Min(Convert.ToInt32(N * Convert.ToDouble(frameCount)), frameCount - 1);

    if (X != 0)
    {
      for(int i = 0;i < 6;i++)
      {
        int[] path = {i,index};
        Plane pln = Plane.Unset;
        GH_Convert.ToPlane(D.Branch(path)[0], ref pln, GH_Conversion.Primary);
        if (i != 4) axes[i] = new Line(pln.Origin, pln.ZAxis, AXIS_LENGTH[i]);
        else axes[i] = new Line(pln.Origin, pln.XAxis, AXIS_LENGTH[i]);
        textPos[i] = axes[i].PointAt(AXIS_POS[i]);
        bb.Union(axes[i].From);
        bb.Union(axes[i].To);

        GH_Convert.ToInt32(D.Branch(path)[1], out status[i], GH_Conversion.Primary);
        GH_Convert.ToDouble(D.Branch(path)[2], out angles[i], GH_Conversion.Primary);
        angles[i] = Math.Round(RhinoMath.ToDegrees(angles[i]), 2);
      }
    }
    else
    {
      Plane[] planes = GetPlanes(L);
      for(int i = 0;i < 5;i++)
      {
        Transform xf = Transform.Rotation(RhinoMath.ToRadians(A[i]), planes[i].ZAxis, planes[i].Origin);
        for(int j = (i + 1);j < 6;j++) planes[j].Transform(xf);
      }

      for(int i = 0;i < 6;i++)
      {
        axes[i] = new Line(planes[i].Origin, planes[i].ZAxis, AXIS_LENGTH[i]);
        textPos[i] = axes[i].PointAt(AXIS_POS[i]);
        angles[i] = A[i];
        bb.Union(axes[i].From);
        bb.Union(axes[i].To);
      }
    }

    bb.Inflate(50);
# ---------- disp_axes: C# additional code ----------
  static double[] AXIS_LENGTH = {-150, 150, 150, -450, -150, 200};
  static double[] AXIS_POS = {0.78, 0.63, 0.63, 0.95, 0.88, 1.0};

  //colors
  static System.Drawing.Color GOOD_AXIS = System.Drawing.Color.FromArgb(0, 120, 200);
  static System.Drawing.Color GOOD_TEXT = System.Drawing.Color.FromArgb(0, 127, 255);
  static System.Drawing.Color BAD_AXIS = System.Drawing.Color.FromArgb(170, 0, 0);
  static System.Drawing.Color BAD_TEXT = System.Drawing.Color.FromArgb(255, 0, 0);

  //dashed Lines & txt
  const double DASH_LENGTH = 15;
  const double GAP_LENGTH = DASH_LENGTH * 0.33;
  const double DOT_LENGTH = GAP_LENGTH * 0.33;
  const double SEG_LENGTH = DASH_LENGTH + GAP_LENGTH + DOT_LENGTH + GAP_LENGTH;
  const double DASH_PARAM = DASH_LENGTH / SEG_LENGTH;
  const double GAP_PARAM = GAP_LENGTH / SEG_LENGTH;
  const double DOT_PARAM = DOT_LENGTH / SEG_LENGTH;

  const int TXT_HT = 16;
  const int LINE_THK = 1;//2


  //dynamic variables
  static Line[] axes;
  static Point3d[] textPos;
  static int[] status;
  static double[] angles;
  static BoundingBox bb;


  //Return a BoundingBox that contains all the geometry you are about to draw.
  public override BoundingBox ClippingBox
    {get{return bb;}}

  //Draw all meshes in this method.
  public override void DrawViewportMeshes(IGH_PreviewArgs args)
  {
  }

  //Draw all wires and points in this method.
  public override void DrawViewportWires(IGH_PreviewArgs args)
  {
    for(int i = 0;i < 6;i++)
    {
      Color col0 = (status[i] == 0 ? GOOD_AXIS : BAD_AXIS);
      args.Display.DrawLines(MakeLineDashed(axes[i]).ToArray(), col0, LINE_THK);

      Color col1 = (status[i] == 0 ? GOOD_TEXT : BAD_TEXT);
      args.Display.Draw2dText("axis_" + (i + 1).ToString() + ":" + angles[i].ToString() + "°", col1, textPos[i], true, TXT_HT, "Arial Bold");
    }
  }

  public Plane[] GetPlanes(List <Line> L)
  {
    Plane[] planes = new Plane[6];
    planes[0] = new Plane(new Point3d(L[0].From.X, L[0].From.Y, 0), Vector3d.XAxis, Vector3d.YAxis);
    planes[1] = new Plane(L[1].To, L[3].Direction, L[0].Direction);
    planes[1].Translate(planes[1].ZAxis * -69.363);
    planes[2] = new Plane(L[2].To, L[3].Direction, L[0].Direction);
    planes[2].Translate(planes[2].ZAxis * -66.341);
    planes[3] = new Plane(L[3].From, L[1].Direction, L[0].Direction);
    planes[3].Translate(planes[3].ZAxis * -366.193);
    planes[3].Flip();
    planes[4] = new Plane(L[4].From, L[3].Direction, L[0].Direction);
    planes[4].Translate(planes[4].ZAxis * -92);
    planes[4].Flip();
    planes[5] = new Plane(planes[3].Origin, L[1].Direction, L[0].Direction);
    planes[5].Flip();
    return planes;
  }



  public List<Line> MakeLineDashed(Line L)
  {
    double segIncrement = 1.0 / Math.Round(L.Length / SEG_LENGTH, 0);
    double dashIncrement = segIncrement * DASH_PARAM;
    double gapIncrement = segIncrement * GAP_PARAM;
    double dotIncrement = segIncrement * DOT_PARAM;

    List<Line> data = new List<Line>();
    for(double param = 0;param <= 1;param += segIncrement)
    {
      data.Add(new Line(L.PointAt(param), L.PointAt(param + dashIncrement)));
      data.Add(new Line(L.PointAt(param + dashIncrement + gapIncrement), L.PointAt(param + dashIncrement + gapIncrement + dotIncrement)));
    }
    return data;
  }
# ---------- end disp_axes ----------
list = ValueList({"n1": 0, "n2": 1, "n3": 2, "n4": 3, "n5": 4, "n6": 5}, selected="n5")
# extruder max speed
expression = Expression(x=extr_max_speed, Expression="Format(\"WRITE vi_lun_w ('{0}') -- extrusion start or max speed\", x)")
# extruder min speed
expression_2 = Expression(x=extr_min_speed, Expression="Format(\"WRITE vi_lun_w ('{0}') -- extrusion stop or min speed\", x)")

Z_4 = UnitZ(Factor=nozzle_height)
# nozzle construction
pt_4 = Point(Point(0, 0, 0))
neg_6 = Negative(Value=devec.XComponent)
move_7 = Move(Geometry=pt_4, Motion=Z_4)  # -> Geometry, Transform
dom_4 = ConstructDomain(DomainStart=neg_6, DomainEnd=devec.XComponent)
cir_2 = Circle(Plane=move_7.Geometry, Radius=upper_radius)
# 6
cir_3 = Circle(Plane=pt_4, Radius=nozzle_radius)
addition = Addition(A=neg_2, B=height_overhead)
mloft = MeshLoft(Curves=[cir_3, cir_2], Segments=10)
Z_5 = UnitZ(Factor=addition)

addition_2 = Addition(A=move_7.Geometry, B=Y)

rectangle = Rectangle(Plane=addition_2, XSize=dom_4, YSize=dom_4, Radius=0)  # -> Rectangle, Length
move_8 = Move(Geometry=rectangle.Rectangle, Motion=Z_5)  # -> Geometry, Transform
mplane = MeshPlane(Boundary=[rectangle.Rectangle, move_8.Geometry], WidthCount="1", HeightCount="1")  # -> Mesh, Area
mloft_2 = MeshLoft(Curves=[rectangle.Rectangle, move_8.Geometry], Segments="4")
wbjoin = WeaverbirdsJoinMeshesAndWeld(Mesh=[mloft_2, mplane.Mesh], Weld=True)
unifynormals = MeshUnifyNormals(Mesh=wbjoin)
mjoin = MeshJoin(Meshes=[mloft, unifynormals])

# ----
# robot geometry
# base points
# NJ_60 Input Parameters
# actuator
panel_4 = Panel("1550.5,0,1620")
panel_5 = Panel("0,568,1620")

pivotax_6 = Point(panel_4)
pivotax_2 = Point("400,0,550")
pivotax_3 = Point("400,0,1410")
pivotax_5 = Point("1375.5,0,1620")

xy_3 = XYPlane(Origin=Point(0, 0, 0))
# Inverse Kinematics (IK)
c_script = CSharpScript(go=calculate_ik, P1=pivotax_2, P2=pivotax_3, P3=pivotax_5, P4=pivotax_6, BasePlane=xy_3, TargetPlane=pln)  # -> out, A1, A2, A3, A4, A5, A6; inputs go: Boolean, P1: Point3d, P2: Point3d, P3: Point3d, P4: Point3d, BasePlane: Plane, TargetPlane: Plane
# ---------- c_script: C# ----------
    //Lobster reloaded
    //Inverse Kinematics definition by Daniel Piker
    //You are free to use and modify without restriction, but acknowledgement is appreciated
    if (go){
      Component.Message = "IK active";
      Transform xform = Rhino.Geometry.Transform.PlaneToPlane(BasePlane, Plane.WorldXY);

      Plane EndPlane = new Plane(TargetPlane.Origin, TargetPlane.YAxis, TargetPlane.XAxis);
      double pi = Math.PI;
      double WristOffset = P4.X - P3.X;
      double LowerArmLength = P1.DistanceTo(P2);
      double UpperArmLength = P2.DistanceTo(P3);
      double Axis4offsetAngle = Math.Atan2(P3.Z - P2.Z, P3.X - P2.X);

      P1.Transform(xform);
      P2.Transform(xform);
      P3.Transform(xform);
      P4.Transform(xform);

      Point3d Wrist = new Point3d(EndPlane.PointAt(0, 0, WristOffset));

      List<double> Axis1Angles = new List<double>();
      List<double> Axis2Angles = new List<double>();
      List<double> Axis3Angles = new List<double>();
      List<double> Axis4Angles = new List<double>();
      List<double> Axis5Angles = new List<double>();
      List<double> Axis6Angles = new List<double>();

      double Axis1Angle = -1 * Math.Atan2(Wrist.Y, Wrist.X);
      //note that this is reversed because the clockwise direction when looking down at the XY plane
      //is typically taken as the positive direction for robot axis1

      if(Axis1Angle > Math.PI)
      {
        Axis1Angle -= 2 * Math.PI;
      }

      for (int i = 0; i < 4; i++)
      {
        Axis1Angles.Add(Axis1Angle);
      }

      Axis1Angle += Math.PI;
      if(Axis1Angle > Math.PI)
      {
        Axis1Angle -= 2 * Math.PI;
      }
      for (int i = 0; i < 4; i++)
      {
        Axis1Angles.Add(1 * Axis1Angle);
      }

      for (int i = 0; i < 2; i++)  // to generate 4 sets of values for each option of axis1
      {
        Axis1Angle = Axis1Angles[i * 4];

        Transform Rot1 = Rhino.Geometry.Transform.Rotation(-1 * Axis1Angle, Point3d.Origin);

        Point3d P1A = new Point3d(P1);
        Point3d P2A = new Point3d(P2);
        Point3d P3A = new Point3d(P3);

        P1A.Transform(Rot1);
        P2A.Transform(Rot1);
        P3A.Transform(Rot1);
        Vector3d ElbowDir = new Vector3d(1, 0, 0);
        ElbowDir.Transform(Rot1);
        Plane ElbowPlane = new Rhino.Geometry.Plane(P1A, ElbowDir, Vector3d.ZAxis);

        Sphere Sphere1 = new Sphere(P1A, LowerArmLength);
        Sphere Sphere2 = new Sphere(Wrist, UpperArmLength);
        Circle Circ = new Circle();

        double Par1 = new double();
        double Par2 = new double();

        Rhino.Geometry.Intersect.Intersection.SphereSphere(Sphere1, Sphere2, out Circ);
        Rhino.Geometry.Intersect.Intersection.PlaneCircle(ElbowPlane, Circ, out Par1, out Par2);

        Point3d IntersectPt1 = Circ.PointAt(Par1);
        Point3d IntersectPt2 = Circ.PointAt(Par2);

        for(int j = 0;j < 2;j++)
        {
          Point3d ElbowPt = new Point3d();

          if(j == 0)
          {ElbowPt = IntersectPt1;}
          else
          {ElbowPt = IntersectPt2;}

          double elbowx,elbowy,wristx,wristy; //parameters in the elbow plane

          ElbowPlane.ClosestParameter(ElbowPt, out elbowx, out elbowy);
          ElbowPlane.ClosestParameter(Wrist, out wristx, out wristy);

          double Axis2Angle = Math.Atan2(elbowy, elbowx);
          double Axis3Angle = Math.PI - Axis2Angle + Math.Atan2(wristy - elbowy, wristx - elbowx) - Axis4offsetAngle;

          for(int k = 0;k < 2;k++)
          {
            Axis2Angles.Add(-Axis2Angle);

            double Axis3AngleWrapped = -Axis3Angle + pi;
            while (Axis3AngleWrapped >= pi) Axis3AngleWrapped -= 2 * pi;
            while (Axis3AngleWrapped < -pi) Axis3AngleWrapped += 2 * pi;
            Axis3Angles.Add(Axis3AngleWrapped);
          }

          for(int k = 0;k < 2;k++)
          {
            Vector3d Axis4 = new Vector3d(Wrist - ElbowPt);
            Axis4.Rotate(-Axis4offsetAngle, ElbowPlane.ZAxis);
            Vector3d LowerArm = new Vector3d(ElbowPt - P1A);
            Plane TempPlane = ElbowPlane;
            TempPlane.Rotate(Axis2Angle + Axis3Angle, TempPlane.ZAxis);

            // B = TempPlane;
            Plane Axis4Plane = new Rhino.Geometry.Plane(Wrist, TempPlane.ZAxis, -1.0 * TempPlane.YAxis);
            double axis6x,axis6y;
            Axis4Plane.ClosestParameter(EndPlane.Origin, out axis6x, out axis6y);

            double Axis4Angle = Math.Atan2(axis6y, axis6x);
            if(k == 1)
            {
              Axis4Angle += Math.PI;
              if(Axis4Angle > Math.PI)
              {
                Axis4Angle -= 2 * Math.PI;
              }
            }

            double Axis4AngleWrapped = Axis4Angle + pi / 2;
            while (Axis4AngleWrapped >= pi) Axis4AngleWrapped -= 2 * pi;
            while (Axis4AngleWrapped < -pi) Axis4AngleWrapped += 2 * pi;
            Axis4Angles.Add(Axis4AngleWrapped);

            Plane Axis5Plane = new Rhino.Geometry.Plane(Axis4Plane);
            Axis5Plane.Rotate(Axis4Angle, Axis4Plane.ZAxis);
            Axis5Plane = new Rhino.Geometry.Plane(Wrist, -Axis5Plane.ZAxis, Axis5Plane.XAxis);
            Axis5Plane.ClosestParameter(EndPlane.Origin, out axis6x, out axis6y);
            double Axis5Angle = Math.Atan2(axis6y, axis6x);
            Axis5Angles.Add(Axis5Angle);

            Plane Axis6Plane = new Rhino.Geometry.Plane(Axis5Plane);
            Axis6Plane.Rotate(Axis5Angle, Axis5Plane.ZAxis);
            Axis6Plane = new Rhino.Geometry.Plane(Wrist, -Axis6Plane.YAxis, Axis6Plane.ZAxis);
            double endx,endy;
            Axis6Plane.ClosestParameter(EndPlane.PointAt(1, 0), out endx, out endy);
            double Axis6Angle = Math.Atan2(endy, endx);
            Axis6Angles.Add(Axis6Angle);
          }
        }
      }
      for(int i = 0;i < 8;i++)
      {
        Axis1Angles[i] = Axis1Angles[i] * 180 / pi;
        Axis2Angles[i] = Axis2Angles[i] * 180 / pi;
        Axis3Angles[i] = Axis3Angles[i] * 180 / pi;
        Axis4Angles[i] = Axis4Angles[i] * 180 / pi;
        Axis5Angles[i] = Axis5Angles[i] * 180 / pi;
        Axis6Angles[i] = Axis6Angles[i] * 180 / pi;
      }
      A1 = Axis1Angles;
      A2 = Axis2Angles;
      A3 = Axis3Angles;
      A4 = Axis4Angles;
      A5 = Axis5Angles;
      A6 = Axis6Angles;
    } else {
      Component.Message = "IK inactive";
      Print("IK calculation inactive");
    }
# ---------- end c_script ----------

# ----
# 7
item_8 = ListItem(List=c_script.A1, Index=ik_solver, Wrap=True)
item_9 = ListItem(List=c_script.A2, Index=ik_solver, Wrap=True)
item_10 = ListItem(List=c_script.A3, Index=ik_solver, Wrap=True)
item_11 = ListItem(List=c_script.A4, Index=ik_solver, Wrap=True)
item_12 = ListItem(List=c_script.A5, Index=ik_solver, Wrap=True)
item_13 = ListItem(List=c_script.A6, Index=ik_solver, Wrap=True)

# ----
# IK solver
# angle compensation
merge_3 = Merge(Data1=item_8, Data2=item_9, Data3=item_10, Data4=item_11, Data5=item_12, Data6=item_13)
num_2 = Number(simplify(merge_3))
c_script_2 = CSharpScript(x=num_2)  # -> out, A; inputs x: list
# ---------- c_script_2: C# ----------
   /*
    note: x is left as System.Object to speed up performance
    see: http://james-ramsden.com/improve-grasshopper-component-performance-by-not-using-data-types/
    */
    x[1] = (double) x[1] + 90;
    x[2] = (double) x[2] * -1;
    A = x;
# ---------- end c_script_2 ----------

angle_compensation = Panel("""x
x+90
-x
x
x
x""")
eval = Evaluate(F=angle_compensation, x=num_2)  # disabled

addition_3 = Addition(A=pivotax_6, B=vec.Vector)
merge_4 = Merge(Data1=pivotax_2, Data2=pivotax_3, Data3=pivotax_5, Data4=pivotax_6)
move_9 = Move(Geometry=mjoin, Motion=addition_3)  # -> Geometry, Transform
mjoin_2 = MeshJoin(Meshes=move_9.Geometry)

robot_node_points = Point(merge_4)

# ---- group: OLD
# clash control
forward_kinematics = CSharpScript(P=robot_node_points, A=num_2, BasePlane=xy_3)  # -> out, n1, n2, n3, n4, n5, n6; inputs P: list of Point3d, A: list of Double, BasePlane: Plane; disabled
# ---------- forward_kinematics: C# ----------
    //your code here
    double pi = Math.PI;
    double A1Rad = (A[0] / 180) * pi;
    double A2Rad = (A[1] / 180) * pi;
    double A3Rad = (A[2] / 180) * pi;
    double A4Rad = (A[3] / 180) * pi;
    double A5Rad = (A[4] / 180) * pi;
    double A6Rad = (A[5] / 180) * pi;

    // Mesh[] RobotMesh = {J1, J2, J3, J4, J5, J6, J7};
    Plane AP1 = Plane.WorldZX;
    AP1.Origin = P[0];
    Plane AP2 = Plane.WorldZX;
    AP2.Origin = P[1];
    Plane AP3 = Plane.WorldYZ;
    AP3.Origin = P[2];
    Plane AP4 = Plane.WorldZX;
    AP4.Origin = P[2];
    Plane AP5 = Plane.WorldYZ;
    AP5.Origin = P[2];
    Plane AP6 = Plane.WorldYZ;
    AP6.Origin = P[3];

    Plane[] AxisPlanes = {AP1,AP2,AP3,AP4,AP5,AP6};

    Transform Rot1 = Rhino.Geometry.Transform.Rotation(-1 * A1Rad, BasePlane.ZAxis, BasePlane.Origin);

    /*
     for (int i = 1;i < 7;i++)
    {
      RobotMesh[i].Transform(Rot1);
    }
    */
    for (int i = 0; i < 6;i++)
    {
      AxisPlanes[i].Transform(Rot1);
    }

    Transform Rot2 = Rhino.Geometry.Transform.Rotation(A2Rad + pi / 2, AxisPlanes[0].ZAxis, AxisPlanes[0].Origin);
  /*
    for (int i = 2;i < 7;i++)
    {
      RobotMesh[i].Transform(Rot2);
    }
  */
    for (int i = 1; i < 6;i++)
    {
      AxisPlanes[i].Transform(Rot2);
    }

    Transform Rot3 = Rhino.Geometry.Transform.Rotation(A3Rad - pi / 2, AxisPlanes[1].ZAxis, AxisPlanes[1].Origin);
/*
    for (int i = 3;i < 7;i++)
    {
      RobotMesh[i].Transform(Rot3);
    }
  */

    for (int i = 2; i < 6;i++)
    {
      AxisPlanes[i].Transform(Rot3);
    }

    Transform Rot4 = Rhino.Geometry.Transform.Rotation(A4Rad * -1.0, AxisPlanes[2].ZAxis, AxisPlanes[2].Origin);
/*
    for (int i = 4;i < 7;i++)
    {
      RobotMesh[i].Transform(Rot4);
    }
  */
    for (int i = 3; i < 6;i++)
    {
      AxisPlanes[i].Transform(Rot4);
    }

    Transform Rot5 = Rhino.Geometry.Transform.Rotation(A5Rad, AxisPlanes[3].ZAxis, AxisPlanes[3].Origin);
/*
    for (int i = 5;i < 7;i++)
    {
      RobotMesh[i].Transform(Rot5);
    }
  */
    for (int i = 4; i < 6;i++)
    {
      AxisPlanes[i].Transform(Rot5);
    }

    Transform Rot6 = Rhino.Geometry.Transform.Rotation(-1.0 * A6Rad, AxisPlanes[4].ZAxis, AxisPlanes[4].Origin);
/*
    for (int i = 6;i < 7;i++)
    {
      RobotMesh[i].Transform(Rot6);
    }
  */
    for (int i = 5; i < 6;i++)
    {
      AxisPlanes[i].Transform(Rot6);
    }

    // Robot = RobotMesh;

    n1 = AxisPlanes[0];
    n2 = AxisPlanes[1];
    n3 = AxisPlanes[2];
    n4 = AxisPlanes[3];
    n5 = AxisPlanes[4];
    n6 = AxisPlanes[5];
# ---------- end forward_kinematics ----------

# ----
forwardkin = CSharpScript(P=robot_node_points, A=num_2, BasePlane=xy_3)  # -> out, Planes; inputs P: list of Point3d, A: list of Double, BasePlane: Plane
# ---------- forwardkin: C# ----------
                    /*
    new forward kinematics component
    transformation methods taken from Suryansh Chandra Open Source Elvis robot project
    http://arcode.blogspot.it/2014/09/introducing-elvis_8.html
    */


    // angles
    double pi = Math.PI;
    double[] ARad = new double[A.Count];
    for (int i = 0; i < ARad.Length; i++){
      ARad[i] = RhinoMath.ToRadians(A[i]);
    }
    ARad[0] *= -1;
    ARad[1] += (pi / 2);
    ARad[2] -= (pi / 2);
    ARad[3] *= -1;
    ARad[5] *= -1;


    // planes
    Plane AP1 = Plane.WorldZX;
    AP1.Origin = P[0];
    Plane AP2 = Plane.WorldZX;
    AP2.Origin = P[1];
    Plane AP3 = Plane.WorldYZ;
    AP3.Origin = P[2];
    Plane AP4 = Plane.WorldZX;
    AP4.Origin = P[2];
    Plane AP5 = Plane.WorldYZ;
    AP5.Origin = P[2];
    Plane AP6 = Plane.WorldYZ;
    AP6.Origin = P[3];
    Plane[] AxisPlanes = {BasePlane,AP1,AP2,AP3,AP4,AP5,AP6};
    Plane[] OutPlanes = new Plane[6];

    // transformations
    Transform xf = Transform.Identity;
    Transform xf1;

    // robot base does not transform
    //body.Append(RobotMesh[0].DuplicateMesh());

    // Calculate transformations
    for(int i = 0;i < 6;i++){
      xf1 = Transform.Rotation(ARad[i], AxisPlanes[i].ZAxis, AxisPlanes[i].Origin);
      xf = Transform.Multiply(xf, xf1);
      Plane temp = AxisPlanes[i + 1];
      temp.Transform(xf);
      OutPlanes[i] = temp;

    }

    Planes = OutPlanes;
# ---------- end forwardkin ----------
item_14 = ListItem(List=forwardkin.Planes, Index=list, Wrap=True)

# ----
# potential clash points
# clash control on node 5 (wrist)
# the radius is the minimum distance between the plane (plus the clay base) and node 5
max_rotations = Panel("""-180 to 180
-60 to 125
-165 to 0
-2700 to 2700
-123 to 123
-2700 to 2700""")
inc = Includes(Value=c_script_2.A, Domain=max_rotations)  # -> Includes, Deviation
control_sphere_radius = Panel("-145")
control_sphere_radius_2 = Panel("-170")
massbool = MassBool(V=flatten(inc.Includes))  # -> out, flatten(A); inputs V: list of Boolean, type: Int32
# ---------- massbool: C# ----------
    Component.Name = "MassBool";
    Component.Description = "Mass boolean operator - type is 0 for AND and 1 for OR operators";
    bool r;
    if (type == 0) {
      Component.Message = "Massive AND";
      r = true;
    }else{
      Component.Message = "Massive OR";
      r = false;
    }


    for (int i = 0; i < V.Count; i++){
      if (type == 0) {
        r = r && V[i];
      }
      else{
        r = r || V[i];
      }
    }
    A = r;
# ---------- end massbool ----------
errhand = CSharpScript(x=inc.Includes)  # -> out, ind; inputs x: tree of Boolean
# ---------- errhand: C# ----------
    String eol = Environment.NewLine;
    Component.Description = "Error handler - tree";
    Component.Message = "error handler" + eol + "tree";
    DataTree<int> posit = new DataTree<int>();
    List <int[]> pos = new List<int[]>();
    int count = 0;
    GH_Path path;
    for(int i = 0; i < x.BranchCount; i++){ // i is the frame
      for(int j = 0; j < x.Branch(i).Count; j++){ // j is the node
        //if (!x.Branch(i)[j]) pos.Add(new int[]{i,j + 1});
        if (!x.Branch(i)[j]) {
          path = new GH_Path(count);
          posit.Add(i, path);
          posit.Add(j + 1, path);
          count++;
        }
      }
    }
    if (count == 0){
      Print("no errors found!");
    }
    else{
      for(int i = 0; i < posit.BranchCount; i++){
        Print("error in frame " + posit.Branch(i)[0].ToString() + " at node "
          + posit.Branch(i)[1].ToString());
        //Print(pos[i][0].ToString());
      }
    }
    ind = posit;
# ---------- end errhand ----------
pln_2 = Plane(item_14)
pt_5 = Point(item_14)
errors_location = Panel(errhand.ind)
errors = Panel(errhand.out)
Z_6 = UnitZ(Factor=control_sphere_radius)
# 8
move_10 = Move(Geometry=pt_5, Motion=Z_6)  # -> Geometry, Transform
pdecon = Deconstruct(Point=move_10.Geometry)  # -> XComponent, YComponent, ZComponent
smaller = SmallerThan(FirstNumber=pdecon.ZComponent, SecondNumber=0)  # -> SmallerThan, flatten(OrEqualTo)
mindex = MemberIndex(Set=smaller.OrEqualTo, Member=Toggle(True))  # -> Index, Count
item_15 = ListItem(List=flatten(move_10.Geometry), Index=mindex.Index, Wrap=True)
indexes_of_potentially_clashing_points = Panel(mindex.Index)
msphere_2 = MeshSphere(Base=item_15, Radius=Slider(5, range=0.1..5), UCount=10, VCount=20)
preview_5 = CustomPreview(Geometry=msphere_2, Shader=ColourSwatch(SwatchColor=RGB(255, 0, 0)))

base = Mesh(<mesh referenced from the Rhino model>)
ax_1 = Mesh([<mesh referenced from the Rhino model> x3])
ax_2 = Mesh(<mesh referenced from the Rhino model>)
ax_3 = Mesh([<mesh referenced from the Rhino model> x2])
ax_4 = Mesh(<mesh referenced from the Rhino model>)
ax_5 = Mesh(<mesh referenced from the Rhino model>)
ax_6 = Mesh(<mesh referenced from the Rhino model>)

mjoin_3 = MeshJoin(Meshes=ax_1)
mjoin_4 = MeshJoin(Meshes=ax_3)
merge_5 = Merge(Data1=base, Data2=mjoin_3, Data3=ax_2, Data4=mjoin_4, Data5=ax_4, Data6=ax_5, Data7=ax_6, Data8=mjoin_2)

robot_mesh = Mesh(merge_5)

# ----
# WARNING: VERY slow
branch = TreeBranch(Tree=num_2, Path=mindex.Index, MaintainPaths=True)
brep = Brep(<brep referenced from the Rhino model>)
# counter verification
forwardkin_2 = CSharpScript(P=robot_node_points, A=branch, BasePlane=xy_3, M=robot_mesh)  # -> out, Robot, Effector, EndPlane; inputs P: list of Point3d, A: list of Double, BasePlane: Plane, M: list of Mesh; disabled
# ---------- forwardkin_2: C# ----------
            /*
    new forward kinematics component
    transformation methods taken from Suryansh Chandra Open Source Elvis robot project
    http://arcode.blogspot.it/2014/09/introducing-elvis_8.html
    */


    // angles
    double pi = Math.PI;
    double[] ARad = new double[A.Count];
    for (int i = 0; i < ARad.Length; i++){
      ARad[i] = RhinoMath.ToRadians(A[i]);
    }
    ARad[0] *= -1;
    ARad[1] += (pi / 2);
    ARad[2] -= (pi / 2);
    ARad[3] *= -1;
    ARad[5] *= -1;

    // mesh
    Mesh body = new Mesh();
    Mesh[] RobotMesh = M.ToArray();
    Mesh effector = new Mesh();

    // planes
    Plane AP1 = Plane.WorldZX;
    AP1.Origin = P[0];
    Plane AP2 = Plane.WorldZX;
    AP2.Origin = P[1];
    Plane AP3 = Plane.WorldYZ;
    AP3.Origin = P[2];
    Plane AP4 = Plane.WorldZX;
    AP4.Origin = P[2];
    Plane AP5 = Plane.WorldYZ;
    AP5.Origin = P[2];
    Plane AP6 = Plane.WorldYZ;
    AP6.Origin = P[3];
    Plane[] AxisPlanes = {BasePlane,AP1,AP2,AP3,AP4,AP5,AP6};

    // transformations
    Transform xf = Transform.Identity;
    Transform xf1;

    // robot base does not transform
    body.Append(RobotMesh[0].DuplicateMesh());

    // Calculate transformations
    for(int i = 0;i < 6;i++){
      xf1 = Transform.Rotation(ARad[i], AxisPlanes[i].ZAxis, AxisPlanes[i].Origin);
      xf = Transform.Multiply(xf, xf1);
      Mesh temp = RobotMesh[i + 1].DuplicateMesh();
      temp.Transform(xf);
      body.Append(temp);
    }
    
    // effector
    temp = RobotMesh[7].DuplicateMesh();
    temp.Transform(xf);
    effector.Append(temp);

    // Calculate transformation for end plane
    AxisPlanes[6].Transform(xf);
    EndPlane = AxisPlanes[6];

    Robot = body;
    Effector = effector;
# ---------- end forwardkin_2 ----------
smesh = SimpleMesh(Brep=brep)
mjoin_5 = MeshJoin(Meshes=forwardkin_2.Robot)
colom = CollisionOneMany(Collider=smesh, Obstacles=mjoin_5)  # -> Collision, Index; disabled
viewer = ParamViewer(colom.Index)
dispatch = Dispatch(List=viewer, DispatchPattern=flatten(colom.Collision))  # -> ListA, ListB
# mesh for visual assessment
swatch_2 = ColourSwatch(SwatchColor=RGB(167, 39, 0))
branch_2 = TreeBranch(Tree=mjoin_5, Path=dispatch.ListA, MaintainPaths=True)
panel_6 = Panel(dispatch.ListA)
preview_6 = CustomPreview(Geometry=branch_2, Shader=swatch_2)

pt_6 = Point(graft(pt_2))
pt_7 = Point(merge)
path_mapper = PathMapper(pt_6, source="{A;B}", target="{path_index}")
number_slider_3 = Slider(2.5, range=0..5)

# ---- group: moving booleans
item_16 = ListItem(List=pt_7, Index=0, Wrap=True)
lng = ListLength(List=pt_7)
lng_2 = ListLength(List=item_16)
repeat = RepeatData(Data="true", Length=lng)
repeat_2 = RepeatData(Data="false", Length=lng_2)
merge_6 = Merge(Data1=repeat_2, Data2=repeat, Data3=repeat_2, Data4=repeat_2)  # -> graft(Result)

# ----
lng_3 = ListLength(List=flatten(pln))
dom_5 = ConstructDomain(DomainStart=0, DomainEnd=expr("x-1", lng_3))
path_mapper_2 = PathMapper(num_2, source="{A;B}", target="{path_index}")
remap_2 = RemapNumbers(Value=robot_position, Source=Domain(0, 1), Target=dom_5)  # -> Mapped, Clipped
int = Integer(remap_2.Mapped)
branch_3 = TreeBranch(Tree=path_mapper_2, Path=int, MaintainPaths=True)
# robot display
swatch_3 = ColourSwatch(SwatchColor=RGB(166, 39, 0))  # disabled
preview_7 = CustomPreview(Shader=swatch_3)  # disabled

filter_3 = StreamFilter(Gate=calculate_ik, Stream0=arm_idle_angles, Stream1=branch_3)
frame_number = Panel(int)
r_preview_old = CSharpScript(P=robot_node_points, A=filter_3, BasePlane=xy_3, M=robot_mesh)  # -> out, EndPlane; inputs P: list of Point3d, A: list of Double, BasePlane: Plane, M: list of Mesh; disabled
# ---------- r_preview_old: C# ----------
    //your code here
    double pi = Math.PI;
    double[] rads = new double[6];
    double A1Rad = (A[0] / 180) * pi;
    double A2Rad = (A[1] / 180) * pi;
    double A3Rad = (A[2] / 180) * pi;
    double A4Rad = (A[3] / 180) * pi;
    double A5Rad = (A[4] / 180) * pi;
    double A6Rad = (A[5] / 180) * pi;

    // Mesh[] RobotMesh = {J1, J2, J3, J4, J5, J6, J7};
    Mesh[] RobotMesh = M.ToArray();
    Plane AP1 = Plane.WorldZX;
    AP1.Origin = P[0];
    Plane AP2 = Plane.WorldZX;
    AP2.Origin = P[1];
    Plane AP3 = Plane.WorldYZ;
    AP3.Origin = P[2];
    Plane AP4 = Plane.WorldZX;
    AP4.Origin = P[2];
    Plane AP5 = Plane.WorldYZ;
    AP5.Origin = P[2];
    Plane AP6 = Plane.WorldYZ;
    AP6.Origin = P[3];

    Plane[] AxisPlanes = {AP1,AP2,AP3,AP4,AP5,AP6};

    Transform Rot1 = Rhino.Geometry.Transform.Rotation(-1 * A1Rad, BasePlane.ZAxis, BasePlane.Origin);

    for (int i = 1;i < 7;i++)
    {
      RobotMesh[i].Transform(Rot1);
    }
    for (int i = 0; i < 6;i++)
    {
      AxisPlanes[i].Transform(Rot1);
    }

    Transform Rot2 = Rhino.Geometry.Transform.Rotation(A2Rad + pi / 2, AxisPlanes[0].ZAxis, AxisPlanes[0].Origin);

    for (int i = 2;i < 7;i++)
    {
      RobotMesh[i].Transform(Rot2);
    }
    for (int i = 1; i < 6;i++)
    {
      AxisPlanes[i].Transform(Rot2);
    }

    Transform Rot3 = Rhino.Geometry.Transform.Rotation(A3Rad - pi / 2, AxisPlanes[1].ZAxis, AxisPlanes[1].Origin);

    for (int i = 3;i < 7;i++)
    {
      RobotMesh[i].Transform(Rot3);
    }
    for (int i = 2; i < 6;i++)
    {
      AxisPlanes[i].Transform(Rot3);
    }

    Transform Rot4 = Rhino.Geometry.Transform.Rotation(A4Rad * -1.0, AxisPlanes[2].ZAxis, AxisPlanes[2].Origin);

    for (int i = 4;i < 7;i++)
    {
      RobotMesh[i].Transform(Rot4);
    }
    for (int i = 3; i < 6;i++)
    {
      AxisPlanes[i].Transform(Rot4);
    }

    Transform Rot5 = Rhino.Geometry.Transform.Rotation(A5Rad, AxisPlanes[3].ZAxis, AxisPlanes[3].Origin);

    for (int i = 5;i < 7;i++)
    {
      RobotMesh[i].Transform(Rot5);
    }
    for (int i = 4; i < 6;i++)
    {
      AxisPlanes[i].Transform(Rot5);
    }

    Transform Rot6 = Rhino.Geometry.Transform.Rotation(-1.0 * A6Rad, AxisPlanes[4].ZAxis, AxisPlanes[4].Origin);

    for (int i = 6;i < 7;i++)
    {
      RobotMesh[i].Transform(Rot6);
    }
    for (int i = 5; i < 6;i++)
    {
      AxisPlanes[i].Transform(Rot6);
    }



    // hides preview of mesh output
    IGH_Param par = Component.Params.Output[1];
    IGH_PreviewObject prev = par as IGH_PreviewObject;
    if (prev != null) prev.Hidden = true;

    //Robot = RobotMesh;
    body = new Mesh();
    // material setup
    mat = new Rhino.Display.DisplayMaterial(BODY_COL, BODY_ALPHA);
    //mat.Transparency = 0.25;

    for (int i = 0; i < RobotMesh.Length; i++){
      body.Append(RobotMesh[i]);
    }

    bb = body.GetBoundingBox(false);
    bb.Inflate(50);

    EndPlane = AxisPlanes[5];
# ---------- r_preview_old: C# additional code ----------
  //colors
  static System.Drawing.Color BODY_COL = System.Drawing.Color.White;
  static double BODY_ALPHA = 0.15;

  //dynamic variables
  static Mesh body;
  static BoundingBox bb;
  static Rhino.Display.DisplayMaterial mat;
  /*
    Rhino.Display.DisplayMaterial material = new Rhino.Display.DisplayMaterial(System.Drawing.Color.FromArgb(red, green, blue), doublePrecisionAlpha);
    material.Transparency = 0.5;
    args.Display.DrawBrepShaded(brep, material);

  */

  //Return a BoundingBox that contains all the geometry you are about to draw.
  public override BoundingBox ClippingBox
    {get{return bb;}}

  //Draw all meshes in this method.
  public override void DrawViewportMeshes(IGH_PreviewArgs args)
  {
    //Color col = Color.FromArgb(10, 100, 100, 100);
    args.Display.DrawMeshShaded(body, mat);
    //args.Display.DrawMeshWires(body, col, 1);//2
    args.Display.DrawMeshWires(body, Color.Black, 1);//2
    args.Display.DrawMeshVertices(body, Color.Black);
  }

  //Draw all wires and points in this method.
  public override void DrawViewportWires(IGH_PreviewArgs args)
  {
  }
# ---------- end r_preview_old ----------
r_preview = CSharpScript(P=robot_node_points, A=filter_3, BasePlane=xy_3, M=robot_mesh)  # -> out, EndPlane; inputs P: list of Point3d, A: list of Double, BasePlane: Plane, M: list of Mesh
# ---------- r_preview: C# ----------
                                        /*
    new forward kinematics and robot display component
    transformation and display methods taken from Suryansh Chandra Open Source Elvis robot project
    http://arcode.blogspot.it/2014/09/introducing-elvis_8.html
    */

    // mesh for display setup
    body = new Mesh();
    effector = new Mesh();

    // material setup
    mat = new Rhino.Display.DisplayMaterial(BODY_COL, BODY_ALPHA);
    //mat.Transparency = 0.25;

    // angles
    double pi = Math.PI;
    double[] ARad = new double[A.Count];
    for (int i = 0; i < ARad.Length; i++){
      ARad[i] = RhinoMath.ToRadians(A[i]);
    }
    ARad[0] *= -1;
    ARad[1] += (pi / 2);
    ARad[2] -= (pi / 2);
    ARad[3] *= -1;
    ARad[5] *= -1;

    // mesh
    Mesh[] RobotMesh = M.ToArray();

    // planes
    Plane AP1 = Plane.WorldZX;
    AP1.Origin = P[0];
    Plane AP2 = Plane.WorldZX;
    AP2.Origin = P[1];
    Plane AP3 = Plane.WorldYZ;
    AP3.Origin = P[2];
    Plane AP4 = Plane.WorldZX;
    AP4.Origin = P[2];
    Plane AP5 = Plane.WorldYZ;
    AP5.Origin = P[2];
    Plane AP6 = Plane.WorldYZ;
    AP6.Origin = P[3];
    Plane[] AxisPlanes = {BasePlane,AP1,AP2,AP3,AP4,AP5,AP6};

    // transformations
    Transform xf = Transform.Identity;
    Transform xf1;

    // robot base does not transform
    body.Append(RobotMesh[0].DuplicateMesh());

    // Calculate transformations
    Mesh temp;
    for(int i = 0;i < 6;i++){
      xf1 = Transform.Rotation(ARad[i], AxisPlanes[i].ZAxis, AxisPlanes[i].Origin);
      xf = Transform.Multiply(xf, xf1);
      temp = RobotMesh[i + 1].DuplicateMesh();
      temp.Transform(xf);
      body.Append(temp);

    }
    // effector
    temp = RobotMesh[7].DuplicateMesh();
    temp.Transform(xf);
    effector.Append(temp);

    // Calculate transformation for end plane
    AxisPlanes[6].Transform(xf);
    EndPlane = AxisPlanes[6];

    // hides preview of mesh output
    IGH_Param par = Component.Params.Output[1];
    IGH_PreviewObject prev = par as IGH_PreviewObject;
    if (prev != null) prev.Hidden = true;

    // bounding box operations for preview
    bb = body.GetBoundingBox(false);
    bb.Inflate(50);
# ---------- r_preview: C# additional code ----------
  //colors
  static System.Drawing.Color BODY_COL = System.Drawing.Color.White; // Color.FromARGB(255,166,39,0);
  static double BODY_ALPHA = 0.15;

  //dynamic variables
  static Mesh body;
  static Mesh effector;
  static BoundingBox bb;
  static Rhino.Display.DisplayMaterial mat;
  /*
    Rhino.Display.DisplayMaterial material = new Rhino.Display.DisplayMaterial(System.Drawing.Color.FromArgb(red, green, blue), doublePrecisionAlpha);
    material.Transparency = 0.5;
    args.Display.DrawBrepShaded(brep, material);

  */

  //Return a BoundingBox that contains all the geometry you are about to draw.
  public override BoundingBox ClippingBox
    {get{return bb;}}

  //Draw all meshes in this method.
  public override void DrawViewportMeshes(IGH_PreviewArgs args)
  {

    args.Display.DrawMeshShaded(body, mat);
    args.Display.DrawMeshShaded(effector, mat);
    args.Display.DrawMeshWires(effector, Color.Black, 1);//2
    //args.Display.DrawMeshVertices(body, Color.Black);
  }

  //Draw all wires and points in this method.
  public override void DrawViewportWires(IGH_PreviewArgs args)
  {
  }
# ---------- end r_preview ----------

# ----
# deposition display
pln_3 = Plane(r_preview.EndPlane)
deplane = DeconstructPlane(Plane=r_preview.EndPlane)  # -> Origin, XAxis, YAxis, ZAxis

series_2 = Series(Start=0, Step=1, Count=expr("x+1", int))
branch_4 = TreeBranch(Tree=path_mapper, Path=series_2, MaintainPaths=True)
path_mapper_3 = PathMapper(merge_6, source="{A;B;C}", target="{path_index}")
pt_8 = Point(branch_4)
branch_5 = TreeBranch(Tree=path_mapper_3, Path=series_2, MaintainPaths=True)
filter_4 = StreamFilter(Gate=display_deposition_as, Stream1=pt_8)
msphere_3 = MeshSphere(Base=filter_4, Radius=nozzle_radius, UCount="4", VCount="3")
weave = Weave(
    Pattern=branch_5,
    Stream0=ColourSwatch(SwatchColor=RGB(255, 0, 0)),
    Stream1=ColourSwatch(SwatchColor=RGB(189, 189, 189)),
    NullGaps=False)

filter_5 = StreamFilter(Gate=display_deposition_as, Stream0=pt_8, Stream1=msphere_3)

preview_8 = CustomPreview(Geometry=filter_5, Shader=weave)

# ----
# variable speed
# filename
# arm override print
# arm override move
panel_7 = Panel("""MOVE LINEAR TO 
MOVEFLY LINEAR TO
MOVE TO
MOVEFLY JOINT TO""")
panel_8 = Panel(""" 
 ADVANCE
 
 ADVANCE""")
panel_9 = Panel("""MOVE TO 
MOVE TO
MOVE TO
MOVE TO""")
txt = Text(file_name)
int_2 = Integer(arm_override_print)
int_3 = Integer(arm_override_move)
# robot code generation
panel_10 = Panel(" ,")
join = TextJoin(Text=c_script_2.A, Join=panel_10)
item_17 = ListItem(List=panel_7, Index=arm_interpolation_mode, Wrap=True)
# arm override print
item_18 = ListItem(List=panel_9, Index=arm_interpolation_mode, Wrap=True)
item_19 = ListItem(List=panel_8, Index=arm_interpolation_mode, Wrap=True)
expression_3 = Expression(x=join, y=item_17, z=item_19, Expression="y&\"{\" & X & \"}\" &z")
concat = Concatenate(FragmentA="$ARM_OVR := ", FragmentB=int_3)
concat_2 = Concatenate(FragmentA="$ARM_OVR := ", FragmentB=int_2)
begin_sequence = Panel("""VAR vs_data : STRING[80] NOSAVE
VAR vi_lun_r : INTEGER NOSAVE
VAR vi_lun_w : INTEGER NOSAVE

-- import/export routine
    ROUTINE toolframe (AI_tool,AI_frame,AI_arm : integer()) exported from tt_tool global

BEGIN

DV_CNTRL(4, 'COM1:', COM_BD115200 OR COM_RDAHD OR COM_BIT8 OR COM_PAR_NO OR COM_STOP1 OR COM_PASAL, 65536)
WRITE LUN_CRT ('Error opening Seril Channel ', NL)
OPEN FILE vi_lun_w ('COM1:', 'w')

TOOLFRAME(1,1,1)
MOVE ARM[1] TO $CAL_SYS

$FLY_TYPE := FLY_NORM
$FLY_PER := 20""")
concat_3 = Concatenate(FragmentA="END ", FragmentB=txt)
expression_4 = Expression(
    x="PROGRAM ",
    y=txt,
    z=begin_sequence,
    v="$ARM_OVR := ",
    w=int_2,
    a=" --regolare velocità spostamento",
    Expression="x&y&z&v&w&a")  # -> flatten(R)

expression_5 = Expression(x=match, Expression="\"$ARM_OVR :=\"&X")  # -> graft(R)
merge_7 = Merge(Data1=simplify(expression_5), Data2=simplify(expression_3))

filter_6 = StreamFilter(Gate=speed, Stream0=expression_3, Stream1=merge_7)
pshift = ShiftPaths(Data=filter_6, Offset=-1)
# 10
filter_7 = StreamFilter(Gate=extrusion_mode, Stream0=pshift, Stream1=flatten(pshift))
viewer_2 = ParamViewer(filter_7)
lng_4 = ListLength(List=viewer_2)
repeat_3 = RepeatData(Data=expression_2, Length=lng_4)
repeat_4 = RepeatData(Data=expression, Length=lng_4)
ins = InsertItems(List=filter_7, Item=graft(repeat_4), Indices="2", Wrap=True)
lng_5 = ListLength(List=ins)
ins_2 = InsertItems(List=ins, Item=graft(repeat_3), Indices=expr("x-2", lng_5), Wrap=True)
ins_3 = InsertItems(List=ins_2, Item=concat, Indices="0", Wrap=True)
ins_4 = InsertItems(List=ins_3, Item=concat_2, Indices="2", Wrap=True)
flatten_3 = FlattenTree(Tree=ins_4, Path="{0}")
item_20 = ListItem(List=flatten_3, Index="1", Wrap=True)
rep = ReplaceText(Text=item_20, Find=item_17, Replace=item_18, RecursiveReplace=False)
rep_2 = ReplaceText(Text=rep, Find="ADVANCE", Replace=" ", RecursiveReplace=False)
replace = ReplaceItems(List=flatten_3, Item=rep_2, Indices="1", Wrap=False)
merge_8 = Merge(
    Data1=simplify(flatten(expression_4)),
    Data2=simplify(flatten(replace)),
    Data3=simplify(flatten("MOVE ARM[1] TO $CAL_SYS")),
    Data4=simplify(flatten(concat_3)))

# ----
# 11
# export code file
dir = CSharpScript(type=local_directory, dir=custom_subdir)  # -> out, A; inputs type: Int32, dir: String
# ---------- dir: C# ----------
    String S = "";
    String root = "";
    String end = "\\";
    switch(type){
      case 0:
        root = Environment.GetFolderPath(Environment.SpecialFolder.Desktop);
        S = "Desktop";
        break;
      case 1:
        root = "C:";
        S = root+end;
        break;
      case 2:
        root = Environment.GetFolderPath(Environment.SpecialFolder.MyDocuments);
        S = "Documents";
        break;
    }
    A = root + end + (dir != null ? (dir + end):"");
    Component.Message = S;
# ---------- end dir ----------
concat_4 = Concatenate(FragmentA=txt, FragmentB=".pdl")
savetofile = SaveToFile(S=merge_8, dir=dir.A, file=concat_4, clash=massbool.A, save=save_pdl_file)  # -> out; inputs S: list of String, dir: String, file: String, clash: Boolean, save: Boolean
# ---------- savetofile: C# ----------
    String eol = Environment.NewLine;
    Component.Message = "write to file";
    Component.Name = "Save to File";
    Component.NickName = "SaveToFile";
    Component.Description = "Saves a text sequence to a file";

    if (save){
      if (!Directory.Exists(dir)) Directory.CreateDirectory(dir);

      String target = dir + file;
      if (save && clash){
        System.IO.File.WriteAllLines(target, S.ToArray());
        Print("file saved as: " + target);
      }else if (!clash) Print("WARNING: clash detected | file cannot be saved");
    } else {
      Print("press save button to save pdl file");
    }
# ---------- end savetofile ----------

message = Panel(savetofile)
directory = Panel(dir.A)
